# Grasshopper definition 01-04_Assemblage 2 objects save-load.gh (Grasshopper 1.0.7)
# Copyright: Co-de-iT
# plug-ins: Human, Assembler, froGH

# ---- group: type 1
crv = Curve([<curve referenced from the Rhino model> x3])

# ---- group: type 2
crv_2 = Curve([<curve referenced from the Rhino model> x2])

crv_3 = Curve([<curve referenced from the Rhino model> x2])

# ---- group: type 1
crv_4 = Curve([<curve referenced from the Rhino model> x4])

# ----
merge = Merge(Data1=crv, Data2=crv_2)
merge_2 = Merge(Data1=crv_4, Data2=crv_3)

rotations = Panel("""0
180""")
lng = ListLength(List=merge_2)
type = Panel("""1
1
1
1
2
2""")
repeat = RepeatData(Data=graft(rotations), Length=lng)
weight = Panel("0")
flip = FlipMatrix(Data=repeat)  # -> simplify(Data)
repeat_2 = RepeatData(Data=weight, Length=lng)

crv_5 = Curve(merge)

type_2 = Panel("""1
1
1
2
2""")
rotations_2 = Panel("""0
180""")
lng_2 = ListLength(List=crv_5)
repeat_3 = RepeatData(Data=graft(rotations_2), Length=lng_2)
weight_2 = Panel("0")
flip_2 = FlipMatrix(Data=repeat_3)  # -> simplify(Data)
repeat_4 = RepeatData(Data=weight_2, Length=lng_2)

# ---- group: Create Handles
handle = ConstructHandle(Polyline=merge_2, RotationAngles=flip, Type=type, Weight=repeat_2)

# Assembler
# 
# Framework for Iterative Assemblages workflow
# 
# code by Alessio Erioli
# 
# v 1.0
# © Co-de-iT 2020 / Creative Commons Attribution-Non Commercial-ShareAlike 4.0 International License
handle_2 = ConstructHandle(Polyline=crv_5, RotationAngles=flip_2, Type=type_2, Weight=repeat_4)

# ----
model_abs_size = BooleanToggle(True)
model_abs_size_2 = BooleanToggle(True)

mesh = Mesh(<mesh referenced from the Rhino model>)
volume = Volume(Geometry=mesh)  # -> Volume, Centroid
name = Panel("blockB")
xy = XYPlane(Origin=volume.Centroid)
X = UnitX(Factor=1)

crv_6 = Curve([<curve referenced from the Rhino model> x12])
pt = Point([<point referenced from the Rhino model> x7])
brep = Brep([<brep referenced from the Rhino model> x7])
brep_2 = Brep([<brep referenced from the Rhino model> x21])
merge_3 = Merge(Data1=crv_6, Data2=pt)
xdcon = ConstructXData(Label="blockB body", Data=merge_3, ReferencePlane=xy, AssemblyObjectNameReference=name)  # disabled

mesh_2 = Mesh(<mesh referenced from the Rhino model>)
volume_2 = Volume(Geometry=mesh_2)  # -> Volume, Centroid
name_2 = Panel("blockA")
xy_2 = XYPlane(Origin=volume_2.Centroid)
X_2 = UnitX(Factor=1)

crv_7 = Curve([<curve referenced from the Rhino model> x12])
pt_2 = Point([<point referenced from the Rhino model> x7])
brep_3 = Brep([<brep referenced from the Rhino model> x21])
brep_4 = Brep([<brep referenced from the Rhino model> x7])
merge_4 = Merge(Data1=crv_7, Data2=pt_2)
xdcon_2 = ConstructXData(Label="blockA body", Data=merge_4, ReferencePlane=xy_2, AssemblyObjectNameReference=name_2)  # disabled

# ---- group: Display Handles
handdisp = DisplayHandle(Handles=handle, DisplaySize=Slider(7.261, range=0..10), ModelScreenSize=model_abs_size)

handdisp_2 = DisplayHandle(Handles=handle_2, DisplaySize=Slider(7.261, range=0..10), ModelScreenSize=model_abs_size_2)

# ---- group: Create AssemblyObject
aocon = ConstructAssemblyObject(Name=name, CollisionMesh=mesh, ReferencePlane=xy, Direction=X, Weight="1.0", Handles=handle)

aocon_2 = ConstructAssemblyObject(Name=name_2, CollisionMesh=mesh_2, ReferencePlane=xy_2, Direction=X_2, Weight="1.0", Handles=handle_2)

# ---- group: XData
merge_5 = Merge(Data1=flatten(xdcon_2), Data2=flatten(xdcon))

# ---- group: AssemblyObjects
merge_6 = Merge(Data1=flatten(aocon_2), Data2=flatten(aocon))

# ----
starting_plane = ValueList({"XY": 0, "YZ": 1, "custom": 2}, selected="XY")
data = Data(merge_6)
pt_3 = Point(Point(-12807.51619, 13383.37939, 0))

self_object = BooleanToggle(True)
self_handle = BooleanToggle(True)
cross_type = BooleanToggle(False)
heuw = HeuristicsWriter(
    AssemblyObjectsSet=data,
    AllowSelfObjectConnections=self_object,
    AllowSelfHandleConnections=self_handle,
    AllowCrossTypeConnections=cross_type)

xy_3 = XYPlane(Origin=pt_3)
yz = YZPlane(Origin=pt_3)
pl = PlaneNormal(Origin=pt_3, ZAxis="1,-1,1")
display = ValueList({"by Type": 0, "by s/r status": 1}, selected="by Type")
filter = StreamFilter(Gate=starting_plane, Stream0=xy_3, Stream1=yz, Stream2=pl)
max_objects = Panel("2000")
step = Button()
reset = Button()

# ---- group: filter heuristics
heudex = HeuristicsDisplayEx(OriginPoint=Point(0, 0, 0), AssemblyObjectsSet=data, HeuristicsString=heuw, XSize=1, YSize=1, NRows=10)  # -> AssemblyObjectPairs, CoherencePattern, HeuristicsStringTree, TextBasePoints, XData
cull = CullPattern(List=flatten(heudex.HeuristicsStringTree), CullPattern=flatten(heudex.CoherencePattern))

# ----
cell_size = Slider(1.2, range=1..2)

# ---- group: base point
pt_4 = Point(Point(0, 1500, 0))

# ----
show_edges = BooleanToggle(True)
heuristics_rules = Panel(heuw)

# ---- group: Random Assemblage Engine
aoeng = AssemblerEngineSimple(
    AssemblyObjectsSet=data,
    StartingPlane=filter,
    StartingObjectType=0,
    HeuristicsString=cull,
    Go=False,
    Step=step,
    NIterations=Slider(100, range=10..100),
    MaxNObjects=max_objects,
    Reset=reset)  # -> Assemblage, AssemblageCount

# ---- group: Heuristics Display
heud = HeuristicDisplay(
    OriginPoint=pt_4,
    AssemblyObjectsSet=data,
    HeuristicsString=heuw,
    XSize=cell_size,
    YSize=cell_size,
    NRows=Slider(10, range=10..50),
    ShowEdges=show_edges,
    DisplayMode=display)

# ----
n_of_objects = Panel(aoeng.AssemblageCount)
display_2 = ValueList({"objects": 0, "occupancy": 1, "type": 2, "sequence": 3, "none": 4}, selected="occupancy")
panel = Panel("""AliceBlue
SlateGray
GoldenRod
YellowGreen
DarkKhaki""")
start_index_optional = Panel("0")

directory = Panel("assemblages\")
f_ghfilepath = GHFilePathInfo()  # -> FileName, FilePath
file_name = Panel("assemblage2comp")
concat = Concatenate(FragmentA=f_ghfilepath.FilePath, FragmentB=directory)
save = BooleanToggle(False)
ao2json = AssemblageToJSON(Assemblage=aoeng.Assemblage, StartIndex=start_index_optional, Directory=concat, FileName=file_name, Save=save)

# ----
# receiver rotation angle (in degrees)
# receiver Handle index
# sender Handle index
# rule integer Weight
# receiver Object name
# sender Object name
# rO | rH = rHA < sO | sH % r_iWeight
panel_2 = Panel("rName|1=90<sName|3%0")
cluster = Cluster(vizmode=display_2, assemblage=aoeng.Assemblage, type_colors=panel, stop_and_go_bool=step)  # -> meshes, edges
panel_3 = Panel(concat)

# ---- group: display components / display edges
previewlw = CustomPreviewLineweights(Geometry=cluster.edges, Shader=ColourSwatch(SwatchColor=RGB(0, 0, 0)), Thickness=Slider(1, range=1..3), Absolute=False)

# ----
panel_4 = Panel(ao2json)

f_dirread = DirectoryReader(DirectoryPath=concat)  # -> FileList, SubdirList
panel_5 = Panel("1")
panel_6 = Panel(f_dirread.FileList)
item = ListItem(List=f_dirread.FileList, Index=0, Wrap=True)
concat_2 = Concatenate(FragmentA=concat, FragmentB=item)
load = BooleanToggle(False)
json2ao = AssemblageFromJSON(FilePath=concat_2, Load=load)
aocmesh = ExtractCollisionMesh(AssemblyObject=json2ao)

# ---- group: display components
mjoin = MeshJoin(Meshes=cluster.meshes)
preview = CustomPreview(
    Geometry=mjoin,
    Material={diffuse=RGB(221, 160, 221), emission=RGB(66, 48, 66), shine=0.5, specular=RGB(255, 255, 255), transparency=0})

# ----
selected_file = Panel(item)

# ---- group: to AOpa input in Engine
data_2 = Data(json2ao)

# ==== cluster Cluster
vizmode = ClusterInput()
assemblage = ClusterInput()
type_colors = ClusterInput()
stop_and_go_bool = ClusterInput()
aoadecon = DeconstructAssemblage(Assemblage=assemblage)  # -> AssemblageObjects, AssemblageRules, ReceiverObjectsIndexes, AvailableObjectIndexes, UnreachableObjectIndexes

# ---- group: extract collision meshes
aocmesh = ExtractCollisionMesh(AssemblyObject=aoadecon.AssemblageObjects)

# ----
gate = StreamGate(Stream=aocmesh, Gate=vizmode)  # -> Target0, Target1, Target2, Target3, Target4

# ---- group: extract object type
aotype = ExtractType(AssemblyObject=aoadecon.AssemblageObjects)

# ----
filter = StreamFilter(Gate=stop_and_go_bool, Stream0=gate.Target3)
lng = ListLength(List=gate.Target1)
repeat = RepeatData(Data="0", Length=lng)

# ---- group: display by assemblage sequence
lng_2 = ListLength(List=filter)  # -> expr("x-1", Length)
f_ifroml = IndexesFromList(D=filter)  # -> i; inputs D: list
# ---------- f_ifroml: C# usings ----------
using System.Linq;
# ---------- f_ifroml: C# ----------
   
 /*
    froGH - a sparse collection of (in)utilities for Grasshopper

    Indexes from Number
    code by Alessio Erioli

    froGH by Co-de-iT is licensed under a Creative Commons Attribution 4.0 International License.
    http://creativecommons.org/licenses/by/4.0/

    */
    initComp();
   
    GH_Integer[] indexes = new GH_Integer[D.Count];

    for(int j = 0; j < D.Count; j++)
      indexes[j] = new GH_Integer(j);

    //A = indexes.Sum(j => j.Value); // uses System.Linq Sum selector function - for each GH_Integer j in indexes add its value to the total sum

    i = indexes;
# ---------- f_ifroml: C# additional code ----------
  void initComp(){
    Component.Name = "Indexes from List";
    Component.NickName = "f_iFromL";
    Component.Description = "Generates a list of 0-based integer indexes from a given list of data";
    Component.Params.Input[0].Name = "Data";
    Component.Params.Input[0].Description = "the list to index";
    Component.Params.Output[0].Name = "Indexes";
    Component.Params.Output[0].Description = "the generated indexes";
  }
# ---------- end f_ifroml ----------
one_over_x = OneOverX(Value=lng_2)
multiplication = Multiplication(A=f_ifroml, B=one_over_x)
sqr = Square(Value=multiplication)
gradient = Gradient(
    LowerLimit=0,
    UpperLimit=1,
    Parameter=sqr,
    stops=[0: RGB(0, 0, 0), 0.498: RGB(56, 136, 150), 0.904: RGB(186, 224, 224), 1: RGB(255, 255, 255)])
mcol = MeshColours(Mesh=graft(filter), Colours=graft(gradient))  # -> flatten(Mesh)

# ----
replace = ReplaceItems(List=repeat, Item="1", Indices=aoadecon.AvailableObjectIndexes, Wrap=False)
replace_2 = ReplaceItems(List=replace, Item="2", Indices=aoadecon.UnreachableObjectIndexes, Wrap=False)

# ---- group: occupied/available visualization
saturated = ColourSwatch(SwatchColor=RGB(112, 117, 57))
available = ColourSwatch(SwatchColor=RGB(255, 255, 255))
unreachable = ColourSwatch(SwatchColor=RGB(194, 199, 137))
weave = Weave(Pattern=graft(replace_2), Stream0=saturated, Stream1=available, Stream2=unreachable, NullGaps=False)  # -> simplify(Weave)
mcol_2 = MeshColours(Mesh=graft(gate.Target1), Colours=weave)  # -> flatten(Mesh)

# ----
item = ListItem(List=type_colors, Index=graft(aotype), Wrap=True)  # -> simplify(Item)

# ---- group: display by component type
mcol_3 = MeshColours(Mesh=graft(gate.Target2), Colours=item)  # -> flatten(Mesh)

# ----
mcol_4 = MeshColours(Mesh=gate.Target0, Colours=ColourSwatch(SwatchColor=RGB(255, 255, 255)))
filter_2 = StreamFilter(Gate=vizmode, Stream0=mcol_4, Stream1=mcol_2, Stream2=mcol_3, Stream3=mcol)
filter_3 = StreamFilter(Gate=stop_and_go_bool, Stream0=filter_2)

# ---- group: extract edges with angle tolerance (many meshes)
f_mmeea = MeshesExtractEdgesWithToleranceAngle(Mesh=filter_3, Angle="45")  # -> flatten(InternalEdges), NakedEdges

# ----
meshes = ClusterOutput(filter_2)
edges = ClusterOutput(f_mmeea.InternalEdges)
