# Grasshopper definition 02-00_Exogenous+Heuristics Settings.gh (Grasshopper 1.0.7)
# Copyright: Co-de-iT
# plug-ins: MeshEdit Components, Human, Assembler

global_scale = Panel("100")
# environment mesh geometries
number_slider = Slider(850, range=1..2000)

# ---- group: obstacle
pt = Point(Point(33675.08591, -66965.76771, 0))
box = CenterBox(Base=pt, X=Slider(406.584, range=10..1000), Y=Slider(156.804, range=10..1000), Z=Slider(182.643, range=10..1000))
scale = Scale(Geometry=box, Center=pt, Factor=global_scale)  # -> Geometry, Transform
mbox = MeshBox(Base=scale.Geometry, XCount="1", YCount="1", ZCount="1")

# field from curve
number_slider_2 = Slider(475.488, range=10..1000)
pt_2 = Point(Point(-15847.26811, 70996.85591, -49532.5307))
box_2 = CenterBox(Base=pt_2, X=Slider(268.774, range=10..1000), Y=Slider(659.809, range=10..1000), Z=number_slider_2)
scale_2 = Scale(Geometry=box_2, Center=pt_2, Factor=global_scale)  # -> Geometry, Transform
mbox_2 = MeshBox(Base=scale_2.Geometry, XCount="1", YCount="1", ZCount="1")

# ---- group: polyline
crv = Curve(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)

# ---- group: smooth curve
crv_2 = Curve(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)

# ----
box_3 = CenterBox(Base="0,0,0", X=Slider(840, range=1..2000), Y=Slider(1200, range=1..2000), Z=number_slider)

# ---- group: attractor curve
crv_3 = Curve(crv)
previewlw = CustomPreviewLineweights(Geometry=crv_3, Shader=ColourSwatch(SwatchColor=RGB(255, 0, 0)), Thickness="5", Absolute=False)

# ----
# Assembler
# 
# Framework for Iterative Assemblages workflow
# 
# code by Alessio Erioli
# 
# v 1.0
# © Co-de-iT 2020 / Creative Commons Attribution-Non Commercial-ShareAlike 4.0 International License
scale_3 = Scale(Geometry=box_3, Center="0,0,0", Factor=global_scale)  # -> Geometry, Transform

# ---- group: container
mbox_3 = MeshBox(Base=scale_3.Geometry, XCount="1", YCount="1", ZCount="1")

# flip normals: A container must have normals pointing inward
flip = MeshFlip(Mesh=mbox_3)

# ----
merge = Merge(Data1=flip, Data2=mbox, Data3=mbox_2)  # -> flatten(Result)

# ---- group: display Environment Geometries
obstacles = ColourSwatch(SwatchColor=RGB(115, 124, 148))
containers = ColourSwatch(SwatchColor=RGB(0, 0, 0))
merge_2 = Merge(Data1=obstacles, Data2=containers)
mesh = Mesh(merge)
cluster = Cluster(environment_meshes=mesh, colours=merge_2, normal_size=Slider(450.535, range=1..1000))

# ---- group: Heuristics String
txt = Text(["blockA|0=0<blockA|0%0", "blockA|0=180<blockA|0%0", "blockA|0=0<blockA|1%0", "blockA|0=180<blockA|1%0", "blockA|0=0<blockA|2%0", "blockA|0=180<blockA|2%0", "blockA|0=0<blockB|0%0", "blockA|0=180<blockB|0%0", "blockA|0=0<blockB|1%0", "blockA|0=180<blockB|1%0"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])

# ----
panel = Panel(txt)

heuristics_mode = ValueList({"manual": 0, "field driven": 1}, selected="manual")
selrule = ValueList({"random": 0, "scalar field": 1, "scalar field acc": 2, "vector field": 3, "vector field acc": 4}, selected="random")
selrec = ValueList({"random": 0, "scalar field": 1, "scalar field acc": 2}, selected="random")
heuset = HeuristicsSettings(
    HeuristicsString=txt,
    CurrentHeuristics=Slider(0, range=0..3),
    HeuristicsMode=heuristics_mode,
    ReceiverSelectionMode=selrec,
    RuleSelectionMode=selrule)

# ---- group: to Assembler Engine Ex
data = Data(heuset)

# ----
afieldn = ConstructFieldN(Box=scale_3.Geometry, NCells=Slider(15, range=10..30))  # -> Field, FieldPoints

# ---- group: calculate scalar
crv_cp = CurveClosestPoint(Point=afieldn.FieldPoints, Curve=crv_3)  # -> Point, Parameter, Distance

# ---- group: calculate vector from tangent
eval = EvaluateCurve(Curve=crv_3, Parameter=crv_cp.Parameter)  # -> Point, Tangent, Angle

# ----
afpop = PopulateField(Field=afieldn.Field, ScalarValues=crv_cp.Distance, VectorValues=eval.Tangent)

# ---- group: display Field
blend = BooleanToggle(False)
merge_3 = Merge(Data1=ColourSwatch(SwatchColor=RGB(255, 0, 0)), Data2=ColourSwatch(SwatchColor=RGB(0, 0, 0)))
multiplication = Multiplication(A=eval.Tangent, B=Slider(52.012, range=1..100), C=global_scale)
afcols = ColorFieldByScalar(Field=afpop, Colors=merge_3, Index=0, Threshold=Slider(0.219, range=0..1), Blend=blend)  # -> Field, Colors
unit = UnitVector(Vector=multiplication)
vdisex = VectorDisplayEx(Point=afieldn.FieldPoints, Vector=multiplication, Colour=unit, Width=2)
preview = CustomPreview(Geometry=afieldn.FieldPoints, Material=afcols.Colors)

# ---- group: Field for Assemblage
data_2 = Data(afcols.Field)

# ----
environment_mode = ValueList({"none": 0, "collision": 1, "centroid": 2}, selected="collision")
exoset = ExogeousSettings(
    EnvironmentMeshes=merge,
    EnvironmentMode=environment_mode,
    Field=data_2,
    FieldScalarThreshold=Slider(0.1, range=0..1),
    Sandbox={Plane=PlaneXY(0, 0, 0), X=Domain(-1, 1), Y=Domain(0, 0), Z=Domain(0, 0)})

# ---- group: to Assembler Engine Ex
data_3 = Data(exoset)

# ----
aoengx = AssemblerEngineX(
    StartingPlane=PlaneXY(0, 0, 0),
    StartingObjectType=0,
    HeuristicsSettings=data,
    ExogenousSettings=data_3,
    Go=False,
    Step=False,
    NIterations=10,
    MaxNObjects=1000,
    ResetExogenous=False,
    Reset=False)  # -> Assemblage, AssemblageCount

# ==== cluster Cluster
environment_meshes = ClusterInput()
colours = ClusterInput()  # First Colour for obstacles, second for containers
normal_size = ClusterInput()
volume = MeshVolume(Mesh=environment_meshes)  # -> Volume, Centroid
smaller = SmallerThan(FirstNumber=volume.Volume, SecondNumber=0)  # -> SmallerThan, OrEqualTo
panel = Panel("""3
1""")
item = ListItem(List=colours, Index=graft(smaller.SmallerThan), Wrap=True)
item_2 = ListItem(List=panel, Index=graft(smaller.SmallerThan), Wrap=True)
medges = MeshEdges(Mesh=environment_meshes)  # -> NakedEdges, InteriorEdges, NonManifoldEdges
facen = FaceNormals(Mesh=environment_meshes)  # -> Centers, Normals
multiplication = Multiplication(A=facen.Normals, B=normal_size)
previewlw = CustomPreviewLineweights(Geometry=medges.InteriorEdges, Shader=graft(item), Thickness=graft(item_2), Absolute=False)
vdisex = VectorDisplayEx(Point=facen.Centers, Vector=multiplication, Colour=graft(item), Width=2)
