# Grasshopper definition 03-01_Fields - populate.gh (Grasshopper 1.0.7)
# Copyright: Co-de-iT
# plug-ins: Human, Assembler

box = CenterBox(Base="0,0,0", X=Slider(840, range=1..2000), Y=Slider(1200, range=1..2000), Z=Slider(850, range=1..2000))
scale = Scale(Geometry=box, Center=Point(0, 0, 0), Factor="100")  # -> Geometry, Transform

edges = BrepEdges(Brep=scale.Geometry)  # -> Naked, Interior, NonManifold
previewlw = CustomPreviewLineweights(Geometry=edges.Interior, Shader=ColourSwatch(SwatchColor=RGB(0, 0, 0)), Absolute=False)

# ---- group: empty field
afieldn = ConstructFieldN(Box=scale.Geometry, NCells=Slider(15, range=10..30))  # -> Field, FieldPoints

# ----
panel = Panel(afieldn.Field)

# ---- group: polyline
crv = Curve(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)

# ---- group: smooth curve
crv_2 = Curve(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)

# ----
# Assembler
# 
# Framework for Iterative Assemblages workflow
# 
# code by Alessio Erioli
# 
# v 1.0
# © Co-de-iT 2020 / Creative Commons Attribution-Non Commercial-ShareAlike 4.0 International License
z_threshold = Slider(-37.956, range=-1000..1000)

# ---- group: attractor curve
# curve
crv_3 = Curve(crv_2)
previewlw_2 = CustomPreviewLineweights(Geometry=crv_3, Shader=ColourSwatch(SwatchColor=RGB(255, 0, 0)), Thickness="5", Absolute=False)

# ---- group: multiple attractor points
pt = Point([Point(42187.04806, 97897.31723, 50117.16787), Point(-69568.52053, -80412.00534, 62.76255449), Point(27.98851503, -86.49690043, -43683.74738)])

# ---- group: single attractor point
pt_2 = Point(Point(-39899.91414, 84577.67247, 30732.93566))

# ----
multiplication = Multiplication(A=z_threshold, B="100")
# simple space partition
pdecon = Deconstruct(Point=afieldn.FieldPoints)  # -> XComponent, YComponent, ZComponent

# ---- group: calculate scalar
# multiple points
dist = Distance(PointA=graft(afieldn.FieldPoints), PointB=pt)
log = Logarithm(Value=dist)
avr = Average(Input=log)  # -> flatten(ArithmeticMean)

# ---- group: calculate vector
xprod = CrossProduct(VectorA=graft(afieldn.FieldPoints), VectorB=pt, Unitize=True)  # -> Vector, Length
avr_2 = Average(Input=xprod.Vector)  # -> flatten(ArithmeticMean)
unit = UnitVector(Vector=avr_2)

# ---- group: allocate vectors
larger = LargerThan(FirstNumber=pdecon.ZComponent, SecondNumber=multiplication)  # -> LargerThan, OrEqualTo
X = UnitX(Factor=1)
Z = UnitZ(Factor=1)
weave = Weave(Pattern=graft(larger.LargerThan), Stream0=X, Stream1=Z, NullGaps=False)  # -> flatten(Weave)
unit_2 = UnitVector(Vector=weave)

# ----
# single point
vec2pt = Vector2Pt(PointA=afieldn.FieldPoints, PointB=pt_2, Unitize=False)  # -> Vector, Length

# ---- group: calculate vectors
Z_2 = UnitZ(Factor=1)
xprod_2 = CrossProduct(VectorA=vec2pt.Vector, VectorB=Z_2, Unitize=True)  # -> Vector, Length
unit_3 = UnitVector(Vector=xprod_2.Vector)

# ---- group: calculate scalar
crv_cp = CurveClosestPoint(Point=afieldn.FieldPoints, Curve=crv_3)  # -> Point, Parameter, Distance

# ---- group: allocate scalars
weave_2 = Weave(Pattern=graft(larger.LargerThan), Stream0="0", Stream1="1", NullGaps=False)  # -> flatten(Weave)

# ---- group: calculate vector
eval = EvaluateCurve(Curve=crv_3, Parameter=crv_cp.Parameter)  # -> Point, Tangent, Angle

# ----
afpop = PopulateField(Field=afieldn.Field, ScalarValues=weave_2, VectorValues=unit_2)
afpop_2 = PopulateField(Field=afieldn.Field, ScalarValues=vec2pt.Length, VectorValues=unit_3)
afpop_3 = PopulateField(Field=afieldn.Field, ScalarValues=avr, VectorValues=unit)
afpop_4 = PopulateField(Field=afieldn.Field, ScalarValues=crv_cp.Distance, VectorValues=eval.Tangent)
list = ValueList({"space partition": 0, "single point": 1, "multiple points": 2, "curve": 3}, selected="space partition")

# ---- group: data color
partition = ColourSwatch(SwatchColor=RGB(255, 255, 255))
single_point = ColourSwatch(SwatchColor=RGB(170, 255, 0))
multiple_points = ColourSwatch(SwatchColor=RGB(255, 212, 0))
curve = ColourSwatch(SwatchColor=RGB(255, 0, 0))
filter = StreamFilter(Gate=list, Stream0=partition, Stream1=single_point, Stream2=multiple_points, Stream3=curve)

# ---- group: Field
filter_2 = StreamFilter(Gate=list, Stream0=afpop, Stream1=afpop_2, Stream2=afpop_3, Stream3=afpop_4)

# ---- group: display Field
blend = BooleanToggle(False)
merge = Merge(Data1=filter, Data2=ColourSwatch(SwatchColor=RGB(0, 0, 0)))
afcols = ColorFieldByScalar(Field=filter_2, Colors=merge, Index=0, Threshold=Slider(0.341, range=0..1), Blend=blend)  # -> Field, Colors

# ---- group: Field for Assemblage
data = Data(afcols.Field)

# ----
afdecon = DeconstructField(Field=data)  # -> Points, ScalarValues, Vectors, IWeights, Colors

# ---- group: display field
vector_scale = Slider(75.644, range=1..100)
vec = Vector(flatten(afdecon.Vectors))
multiplication_2 = Multiplication(A=vec, B=vector_scale, C="100")
unit_4 = UnitVector(Vector=multiplication_2)
vdisex = VectorDisplayEx(Point=afdecon.Points, Vector=multiplication_2, Colour=unit_4, Width=2)
preview = CustomPreview(Geometry=afdecon.Points, Material=afcols.Colors)

# ----
vector_values = Panel(afdecon.Vectors)
points = Panel(afdecon.Points)
scalar_values = Panel(afdecon.ScalarValues)
color_values = Panel(afdecon.Colors)
