# Grasshopper definition 03-03_Fields - populate iWeights multiple.gh (Grasshopper 1.0.7)
# Copyright: Co-de-iT
# plug-ins: Human, Assembler, froGH

box = CenterBox(Base="0,0,0", X=Slider(94, range=1..200), Y=Slider(120, range=1..200), Z=Slider(85, range=1..200))

edges = BrepEdges(Brep=box)  # -> Naked, Interior, NonManifold
previewlw = CustomPreviewLineweights(Geometry=edges.Interior, Shader=ColourSwatch(SwatchColor=RGB(0, 0, 0)), Absolute=False)

# ---- group: multiple attractor points
pt = Point(Point(-48.84849901, -75.02945501, -5.148424688))
pt_2 = Point(Point(-42.49842075, 73.73951069, -41.80343786))
pt_3 = Point(Point(68.60664749, -31.08153187, 43.23515265))
# Assembler
# 
# Framework for Iterative Assemblages workflow
# 
# code by Alessio Erioli
# 
# v 1.0
# © Co-de-iT 2020 / Creative Commons Attribution-Non Commercial-ShareAlike 4.0 International License
merge = Merge(Data1=pt, Data2=pt_3, Data3=pt_2)

# ----
panel = Panel("""20
10
0""")
panel_2 = Panel("""0
10
20""")
panel_3 = Panel("""10
0
20""")

# ---- group: empty field
afieldn = ConstructFieldN(Box=box, NCells=Slider(15, range=10..30))  # -> Field, FieldPoints

# ----
panel_4 = Panel(afieldn.Field)
entwine = Entwine(Branch00=panel_2, Branch01=panel, Branch02=panel_3, FlattenInputs=True)

# ---- group: calculate vector
xprod = CrossProduct(VectorA=graft(afieldn.FieldPoints), VectorB=merge, Unitize=True)  # -> Vector, Length
avr = Average(Input=xprod.Vector)  # -> flatten(ArithmeticMean)
unit = UnitVector(Vector=avr)

# ---- group: calculate scalar
dist = Distance(PointA=graft(afieldn.FieldPoints), PointB=merge)
log = Logarithm(Value=dist)
avr_2 = Average(Input=log)  # -> flatten(ArithmeticMean)

# ---- group: generate colors by attractors
f_ifroml = IndexesFromList(Data=merge)
lng = ListLength(List=f_ifroml)
wheel = ColourWheel(
    lng,
    ColourGrips_Style=20,
    ColourGrips_Grip=[3.852552882, 2.112129398, 3.910274516, 2.863076965],
    ColourGrips_Lum=[0.1, 0.7575425545],
    ColourGrips_Range=[0.2617993878, 0.4985281605, 0.2617993878, 0.2617993878],
    ColourGrips_Sat=[0.2, 0.8073025463])

# ---- group: Populate Field (scalar/vectors)
afpop = PopulateField(Field=afieldn.Field, ScalarValues=avr_2, VectorValues=unit)

# ----
panel_5 = Panel("""0
10
20""")
panel_6 = Panel("""20
10
0""")
number_slider = Slider(0.481, range=0..1)
blend = BooleanToggle(False)
blend_2 = BooleanToggle(False)
entwine_2 = Entwine(Branch00=panel_5, Branch01=panel_6, FlattenInputs=True)

# ---- group: generate colors by attractors / colour chart
legend = Legend(Colour=wheel, Tags=f_ifroml, LegendType=1)

# ---- group: Populate iWeights
afpopwa = PopulateFieldIWeightsAttractors(Field=afieldn.Field, AttractorPoints=merge, IWeightValues=entwine, Blend=blend)

# ---- group: Populate iWeights by scalar
afpopws = PopulateFieldIWeightsScalar(Field=afpop, IWeightValues=entwine_2, Index=0, Threshold=number_slider, Blend=blend_2)

# ----
merge_2 = Merge(Data1=ColourSwatch(SwatchColor=RGB(164, 207, 245)), Data2=ColourSwatch(SwatchColor=RGB(173, 31, 31)))
afcola = ColorFieldByAttractors(Field=afpopwa, AttractorPoints=merge, AttractorColors=wheel, Blend=blend)  # -> Field, Colors
afcols = ColorFieldByScalar(Field=afpopws, Colors=merge_2, Index=0, Threshold=number_slider, Blend=blend_2)  # -> Field, Colors
list = ValueList({"by attractors": 0, "by scalar": 1}, selected="by attractors")
filter = StreamFilter(Gate=list, Stream0=afcola.Field, Stream1=afcols.Field)
afdecon = DeconstructField(Field=filter)  # -> Points, ScalarValues, Vectors, IWeights, graft(Colors)
join = TextJoin(Text=afdecon.IWeights)
tag = TextTag3D(Location=graft(afdecon.Points), Text=join, Size="2", Colour=afdecon.Colors, Justification=5)
