# Grasshopper definition 04-00_Assemblage 2 Objects Environment-Field.gh (Grasshopper 1.0.7)
# Copyright: Co-de-iT
# plug-ins: MeshEdit Components, Human, EleFront, Assembler, froGH

# ---- group: container
pt = Point(Point(-13857.30284, 19480.88136, 0))
box = CenterBox(Base=pt, X=Slider(6213.85, range=100..20000), Y=Slider(15026.558, range=100..20000), Z=Slider(304.863, range=100..20000))
mbox = MeshBox(Base=box, XCount="1", YCount="1", ZCount="1")

# ---- group: obstacle
pt_2 = Point(Point(-15847.26811, 17657.88105, 0))
box_2 = CenterBox(Base=pt_2, X=Slider(1100, range=100..20000), Y=Slider(2250, range=100..20000), Z=Slider(2600, range=100..20000))
mbox_2 = MeshBox(Base=box_2, XCount="1", YCount="1", ZCount="1")

pt_3 = Point(Point(-12233.39923, 28215.86602, 0))
box_3 = CenterBox(Base=pt_3, X=Slider(2400, range=100..20000), Y=Slider(900, range=100..20000), Z=Slider(2600, range=100..20000))
mbox_3 = MeshBox(Base=box_3, XCount="1", YCount="1", ZCount="1")

# ---- group: type 1
crv = Curve([<curve referenced from the Rhino model> x4])

# ---- group: type 2
crv_2 = Curve([<curve referenced from the Rhino model> x2])

# ---- group: type 1
# 0 - construct
crv_3 = Curve([<curve referenced from the Rhino model> x3])

# ---- group: type 2
crv_4 = Curve([<curve referenced from the Rhino model> x2])

# ---- group: container for Field
pt_4 = Point(Point(-13818.08912, 22547.66721, 0))
box_4 = CenterBox(Base=pt_4, X=Slider(972, range=1..2000), Y=Slider(1313, range=1..2000), Z=Slider(677, range=1..2000))
global_scale = Panel("10")
scale = Scale(Geometry=box_4, Center=pt_4, Factor=global_scale)  # -> Geometry, Transform

# ----
merge = Merge(Data1=flatten(crv), Data2=flatten(crv_2))
merge_2 = Merge(Data1=flatten(crv_3), Data3=flatten(crv_4))

rotations = Panel("""0
180""")
lng = ListLength(List=merge)
type = Panel("""1
1
1
1
2
2""")
repeat = RepeatData(Data=graft(rotations), Length=lng)
weight = Panel("0")
flip = FlipMatrix(Data=repeat)  # -> simplify(Data)
repeat_2 = RepeatData(Data=weight, Length=lng)

# ----
# ASSEMBLAGES IN BRIEF: GENERAL STEPS
# 
# . choose WHERE to add
# 
# . choose WHAT to add
# 
# 
# PROCESS STEPS
# 
# 
# 
# . select receiver object in the assemblage
# 
# . list all possible combinations of free handles and related compatible candidates
# 
# . choose a winnig candidate according to given criteria
# DEFINITION ANATOMY: 00 - constuct
# 
# Construct the object and relationships necessary for the Assemblage
# 
# 
# 
# 01 - simulate
# 
# Simulate the Assemblage growth
# 
# 
# 
# 02 - analyze/post-process
# 
# Analyze results and post-process the obtained assemblage
rotations_2 = Panel("""0
180""")
lng_2 = ListLength(List=merge_2)
type_2 = Panel("""1
1
1
2
2""")
repeat_3 = RepeatData(Data=graft(rotations_2), Length=lng_2)
weight_2 = Panel("0")
flip_2 = FlipMatrix(Data=repeat_3)  # -> simplify(Data)
repeat_4 = RepeatData(Data=weight_2, Length=lng_2)

# ---- group: single container
mesh = Mesh(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)

# ---- group: smooth curve
crv_5 = Curve(<curve referenced from the Rhino model>)

# ---- group: polyline
crv_6 = Curve(<curve referenced from the Rhino model>)

# ----
environment = ValueList({"single mesh container": 0, "container + obstacles": 1, "field container": 2, "field + obstacles": 3}, selected="field + obstacles")

# ---- group: single container
# flip normals: A container must have normals pointing inward
flip_3 = MeshFlip(Mesh=mesh)

# ---- group: container
# flip normals: A container must have normals pointing inward
flip_4 = MeshFlip(Mesh=mbox)

# ---- group: Create Handles
handle = ConstructHandle(Polyline=merge, RotationAngles=flip, Type=type, Weight=repeat_2)

# ---- group: attractor curve
crv_7 = Curve(crv_5)
previewlw = CustomPreviewLineweights(Geometry=crv_7, Shader=ColourSwatch(SwatchColor=RGB(255, 0, 0)), Thickness="5", Absolute=False)

# ---- group: Create Handles
handle_2 = ConstructHandle(Polyline=merge_2, RotationAngles=flip_2, Type=type_2, Weight=repeat_4)

# ---- group: set box as environment container
smesh = SimpleMesh(Brep=scale.Geometry)
flip_5 = MeshFlip(Mesh=smesh)

# ----
afieldn = ConstructFieldN(Box=scale.Geometry, NCells=Slider(15, range=10..30))  # -> Field, FieldPoints
model_abs_size = BooleanToggle(True)
model_abs_size_2 = BooleanToggle(True)

merge_3 = Merge(Data1=flip_4, Data2=mbox_2, Data3=mbox_3)  # -> flatten(Result)

mesh_2 = Mesh(<mesh referenced from the Rhino model>)
volume = Volume(Geometry=mesh_2)  # -> Volume, Centroid
name = Panel("blockB")
xy = XYPlane(Origin=volume.Centroid)
X = UnitX(Factor=1)

crv_8 = Curve([<curve referenced from the Rhino model> x11])
pt_5 = Point([<point referenced from the Rhino model> x7])
brep = Brep()
brep_2 = Brep([<brep referenced from the Rhino model> x21])
xdcon = ConstructXData(Label="blockB body", Data=crv_8, ReferencePlane=xy, AssemblyObjectNameReference=name)

# ----
# Assembler
# 
# Framework for Iterative Assemblages workflow
# 
# code by Alessio Erioli
# 
# v 1.0
# © Co-de-iT 2020 / Creative Commons Attribution-Non Commercial-ShareAlike 4.0 International License
mesh_3 = Mesh(<mesh referenced from the Rhino model>)
volume_2 = Volume(Geometry=mesh_3)  # -> Volume, Centroid
name_2 = Panel("blockA")
xy_2 = XYPlane(Origin=volume_2.Centroid)
X_2 = UnitX(Factor=1)

crv_9 = Curve([<curve referenced from the Rhino model> x13])
pt_6 = Point([<point referenced from the Rhino model> x7])
brep_3 = Brep()
brep_4 = Brep(<brep referenced from the Rhino model>)
xdcon_2 = ConstructXData(Label="blockA body", Data=crv_9, ReferencePlane=xy_2, AssemblyObjectNameReference=name_2)

# ---- group: Display Handles
handdisp = DisplayHandle(Handles=handle, DisplaySize=Slider(7.261, range=0..10), ModelScreenSize=model_abs_size)

handdisp_2 = DisplayHandle(Handles=handle_2, DisplaySize=Slider(7.261, range=0..10), ModelScreenSize=model_abs_size_2)

# ----
merge_4 = Merge(Data1=flip_5, Data2=mbox_2, Data3=mbox_3)  # -> flatten(Result)

# ---- group: calculate scalar
crv_cp = CurveClosestPoint(Point=afieldn.FieldPoints, Curve=crv_7)  # -> Point, Parameter, Distance

# ----
filter = StreamFilter(Gate=environment, Stream0=flip_3, Stream1=merge_3, Stream2=flip_5, Stream3=merge_4)

# ---- group: Create AssemblyObject
aocon = ConstructAssemblyObject(Name=name_2, CollisionMesh=mesh_3, ReferencePlane=xy_2, Direction=X_2, Weight="1.0", Handles=handle_2)

aocon_2 = ConstructAssemblyObject(Name=name, CollisionMesh=mesh_2, ReferencePlane=xy, Direction=X, Weight="1.0", Handles=handle)

# ----
pdecon = Deconstruct(Point=afieldn.FieldPoints)  # -> XComponent, YComponent, ZComponent

# ---- group: display Environment Geometries
obstacles = ColourSwatch(SwatchColor=RGB(115, 124, 148))
containers = ColourSwatch(SwatchColor=RGB(0, 0, 0))
merge_5 = Merge(Data1=obstacles, Data2=containers)
mesh_4 = Mesh(filter)
cluster = Cluster(environment_meshes=mesh_4, colours=merge_5, normal_size=Slider(500, range=1..1000))

# ---- group: calculate vector
eval = EvaluateCurve(Curve=crv_7, Parameter=crv_cp.Parameter)  # -> Point, Tangent, Angle

# ----
bnd = Bounds(Numbers=pdecon.YComponent)
remap = RemapNumbers(Value=Slider(0.457, range=0..1), Source=Domain(0, 1), Target=bnd)  # -> Mapped, Clipped
smaller = SmallerThan(FirstNumber=pdecon.YComponent, SecondNumber=remap.Mapped)  # -> SmallerThan, OrEqualTo
Y = UnitY(Factor=1)
Z = UnitZ(Factor=1)
list = ValueList({"by curve tangent": 0, "by threshold": 1}, selected="by threshold")
weave = Weave(Pattern=graft(smaller.SmallerThan), Stream0=Y, Stream1=Z, NullGaps=False)  # -> flatten(Weave)

# ---- group: XData
merge_6 = Merge(Data1=flatten(xdcon_2), Data2=flatten(xdcon))

# ---- group: AssemblyObjects
merge_7 = Merge(Data1=flatten(aocon), Data2=flatten(aocon_2))

# ----
filter_2 = StreamFilter(Gate=list, Stream0=eval.Tangent, Stream1=weave)
afpop = PopulateField(Field=afieldn.Field, ScalarValues=crv_cp.Distance, VectorValues=filter_2)

# ---- group: display Field
blend = BooleanToggle(False)
merge_8 = Merge(Data1=ColourSwatch(SwatchColor=RGB(255, 0, 0)), Data2=ColourSwatch(SwatchColor=RGB(0, 0, 0)))
multiplication = Multiplication(A=filter_2, B=Slider(492.952, range=1..1000))
afcols = ColorFieldByScalar(Field=afpop, Colors=merge_8, Index=0, Threshold=Slider(0.2, range=0..1), Blend=blend)  # -> Field, Colors
unit = UnitVector(Vector=multiplication)
vdisex = VectorDisplayEx(Point=afieldn.FieldPoints, Vector=multiplication, Colour=unit, Width=2)
preview = CustomPreview(Geometry=afieldn.FieldPoints, Material=afcols.Colors)

# ----
self_object = BooleanToggle(True)
self_handle = BooleanToggle(True)
cross_type = BooleanToggle(False)
heuw = HeuristicsWriter(
    AssemblyObjectsSet=merge_7,
    AllowSelfObjectConnections=self_object,
    AllowSelfHandleConnections=self_handle,
    AllowCrossTypeConnections=cross_type)

# ---- group: filter heuristics
heudex = HeuristicsDisplayEx(OriginPoint=Point(0, 0, 0), AssemblyObjectsSet=merge_7, HeuristicsString=heuw, XSize=1, YSize=1, NRows=10)  # -> AssemblyObjectPairs, CoherencePattern, HeuristicsStringTree, TextBasePoints, XData
cull = CullPattern(List=flatten(heudex.HeuristicsStringTree), CullPattern=flatten(heudex.CoherencePattern))

# ----
heuristics_mode = ValueList({"manual": 0, "field driven": 1}, selected="manual")
selrule = ValueList({"random": 0, "scalar field": 1, "vector field": 2}, selected="vector field")
selrec = ValueList({"random": 0, "scalar field": 1}, selected="scalar field")
heuset = HeuristicsSettings(
    HeuristicsString=cull,
    CurrentHeuristics=Slider(0, range=0..3),
    HeuristicsMode=heuristics_mode,
    ReceiverSelectionMode=selrec,
    RuleSelectionMode=selrule)

display = ValueList({"by Type": 0, "by s/r status": 1}, selected="by Type")
go = BooleanToggle(False)
step = Button()
max_objects = Panel("2000")
resetex = Button()
reset = Button()
cell_size = Slider(1.2, range=1..2)
show_edges = BooleanToggle(True)

# ---- group: base point
pt_7 = Point(Point(0, 1500, 0))

# ----
pt_8 = Point(Point(-12807.51619, 13383.37939, 0))

# ---- group: Field for Assemblage
data = Data(afcols.Field)

# ----
environment_mode = ValueList({"none": 0, "collision": 1, "centroid": 2}, selected="collision")
box_5 = Box()
exoset = ExogeousSettings(
    EnvironmentMeshes=filter,
    EnvironmentMode=environment_mode,
    Field=data,
    FieldScalarThreshold=Slider(0.1, range=0..1),
    Sandbox={Plane=PlaneXY(0, 0, 0), X=Domain(-1, 1), Y=Domain(0, 0), Z=Domain(0, 0)})

# ---- group: Heuristics Display
heud = HeuristicDisplay(
    OriginPoint=pt_7,
    AssemblyObjectsSet=merge_7,
    HeuristicsString=heuw,
    XSize=cell_size,
    YSize=cell_size,
    NRows=Slider(10, range=10..50),
    ShowEdges=show_edges,
    DisplayMode=display)

# ----
# 1 - simulate
xy_3 = XYPlane(Origin=pt_8)

# ---- group: Assemblage Engine Xtended
aoengx = AssemblerEngineX(
    AssemblyObjectsSet=merge_7,
    StartingPlane=xy_3,
    StartingObjectType=0,
    HeuristicsSettings=heuset,
    ExogenousSettings=exoset,
    Go=go,
    Step=step,
    NIterations=Slider(100, range=10..100),
    MaxNObjects=max_objects,
    ResetExogenous=resetex,
    Reset=reset)  # -> Assemblage, AssemblageCount

# ----
n_of_objects = Panel(aoengx.AssemblageCount)

# ---- group: auto-stop
larger = LargerThan(FirstNumber=aoengx.AssemblageCount, SecondNumber=max_objects)  # -> LargerThan, OrEqualTo
f_tas = ToggleAutostop(Toggle=go, Condition=larger.OrEqualTo)

# ----
# 2 - analyze/post-process
display_2 = ValueList({"objects": 0, "occupancy": 1, "type": 2, "sequence": 3, "none": 4}, selected="occupancy")

# ---- group: data dam
# delays updated data transmission by a certain amount of time or only when clicked
dam = DataDam(DataA=aoengx.Assemblage, BufferDelay=10000000, BufferMode=0)

# ----
panel = Panel("""AliceBlue
SlateGray
GoldenRod
YellowGreen
DarkKhaki""")
aoadecon = DeconstructAssemblage(Assemblage=dam)  # -> AssemblageObjects, AssemblageRules, ReceiverObjectsIndexes, AvailableObjectIndexes, UnreachableObjectIndexes; disabled
cluster_2 = Cluster_2(vizmode=display_2, assemblage=aoengx.Assemblage, type_colors=panel, stop_and_go_bool=step)  # -> meshes, edges
aocmesh = ExtractCollisionMesh(AssemblyObject=aoadecon.AssemblageObjects)  # disabled
aotype = ExtractType(AssemblyObject=aoadecon.AssemblageObjects)

# ---- group: display components
mjoin = MeshJoin(Meshes=cluster_2.meshes)
preview_2 = CustomPreview(
    Geometry=mjoin,
    Material={diffuse=RGB(221, 160, 221), emission=RGB(66, 48, 66), shine=0.5, specular=RGB(255, 255, 255), transparency=0})

# ---- group: display components / display edges
previewlw_2 = CustomPreviewLineweights(Geometry=cluster_2.edges, Shader=ColourSwatch(SwatchColor=RGB(0, 0, 0)), Thickness=Slider(1, range=1..3), Absolute=False)

# ----
sift = SiftPattern(List=aoadecon.AssemblageObjects, SiftPattern=aotype)  # -> Output0, Output1
aoplane = ExtractReferencePlane(AssemblyObject=sift.Output0)
aoplane_2 = ExtractReferencePlane(AssemblyObject=sift.Output1)

# ---- group: apply blocks
inblock = InsertBlock(BlockName="blockA_v1", SourcePlane=aoplane)
inblock_2 = InsertBlock(BlockName="blockB", SourcePlane=aoplane_2)
bake = BooleanToggle(False)

# ----
combine = CombineData(Input0=inblock, Input1=inblock_2)  # -> Result, Index

# ---- group: apply blocks (continued)
bake_2 = BakeObjects(Geometry=combine.Result, Bake=bake)

# ==== cluster Cluster
environment_meshes = ClusterInput()
colours = ClusterInput()  # First Colour for obstacles, second for containers
normal_size = ClusterInput()
volume = MeshVolume(Mesh=environment_meshes)  # -> Volume, Centroid
smaller = SmallerThan(FirstNumber=volume.Volume, SecondNumber=0)  # -> SmallerThan, OrEqualTo
panel = Panel("""3
1""")
item = ListItem(List=colours, Index=graft(smaller.SmallerThan), Wrap=True)
item_2 = ListItem(List=panel, Index=graft(smaller.SmallerThan), Wrap=True)
medges = MeshEdges(Mesh=environment_meshes)  # -> NakedEdges, InteriorEdges, NonManifoldEdges
facen = FaceNormals(Mesh=environment_meshes)  # -> Centers, Normals
multiplication = Multiplication(A=facen.Normals, B=normal_size)
previewlw = CustomPreviewLineweights(Geometry=medges.InteriorEdges, Shader=graft(item), Thickness=graft(item_2), Absolute=False)
vdisex = VectorDisplayEx(Point=facen.Centers, Vector=multiplication, Colour=graft(item), Width=2)

# ==== cluster Cluster_2
vizmode = ClusterInput()
assemblage = ClusterInput()
type_colors = ClusterInput()
stop_and_go_bool = ClusterInput()
aoadecon = DeconstructAssemblage(Assemblage=assemblage)  # -> AssemblageObjects, AssemblageRules, ReceiverObjectsIndexes, AvailableObjectIndexes, UnreachableObjectIndexes

# ---- group: extract collision meshes
aocmesh = ExtractCollisionMesh(AssemblyObject=aoadecon.AssemblageObjects)

# ----
gate = StreamGate(Stream=aocmesh, Gate=vizmode)  # -> Target0, Target1, Target2, Target3, Target4

# ---- group: extract object type
aotype = ExtractType(AssemblyObject=aoadecon.AssemblageObjects)

# ----
filter = StreamFilter(Gate=stop_and_go_bool, Stream0=gate.Target3)
lng = ListLength(List=gate.Target1)
repeat = RepeatData(Data="0", Length=lng)

# ---- group: display by assemblage sequence
lng_2 = ListLength(List=filter)  # -> expr("x-1", Length)
f_ifroml = IndexesFromList(D=filter)  # -> i; inputs D: list
# ---------- f_ifroml: C# usings ----------
using System.Linq;
# ---------- f_ifroml: C# ----------
   
 /*
    froGH - a sparse collection of (in)utilities for Grasshopper

    Indexes from Number
    code by Alessio Erioli

    froGH by Co-de-iT is licensed under a Creative Commons Attribution 4.0 International License.
    http://creativecommons.org/licenses/by/4.0/

    */
    initComp();
   
    GH_Integer[] indexes = new GH_Integer[D.Count];

    for(int j = 0; j < D.Count; j++)
      indexes[j] = new GH_Integer(j);

    //A = indexes.Sum(j => j.Value); // uses System.Linq Sum selector function - for each GH_Integer j in indexes add its value to the total sum

    i = indexes;
# ---------- f_ifroml: C# additional code ----------
  void initComp(){
    Component.Name = "Indexes from List";
    Component.NickName = "f_iFromL";
    Component.Description = "Generates a list of 0-based integer indexes from a given list of data";
    Component.Params.Input[0].Name = "Data";
    Component.Params.Input[0].Description = "the list to index";
    Component.Params.Output[0].Name = "Indexes";
    Component.Params.Output[0].Description = "the generated indexes";
  }
# ---------- end f_ifroml ----------
one_over_x = OneOverX(Value=lng_2)
multiplication = Multiplication(A=f_ifroml, B=one_over_x)
sqr = Square(Value=multiplication)
gradient = Gradient(
    LowerLimit=0,
    UpperLimit=1,
    Parameter=sqr,
    stops=[0: RGB(0, 0, 0), 0.498: RGB(56, 136, 150), 0.904: RGB(186, 224, 224), 1: RGB(255, 255, 255)])
mcol = MeshColours(Mesh=graft(filter), Colours=graft(gradient))  # -> flatten(Mesh)

# ----
replace = ReplaceItems(List=repeat, Item="1", Indices=aoadecon.AvailableObjectIndexes, Wrap=False)
replace_2 = ReplaceItems(List=replace, Item="2", Indices=aoadecon.UnreachableObjectIndexes, Wrap=False)

# ---- group: occupied/available visualization
saturated = ColourSwatch(SwatchColor=RGB(112, 117, 57))
available = ColourSwatch(SwatchColor=RGB(255, 255, 255))
unreachable = ColourSwatch(SwatchColor=RGB(194, 199, 137))
weave = Weave(Pattern=graft(replace_2), Stream0=saturated, Stream1=available, Stream2=unreachable, NullGaps=False)  # -> simplify(Weave)
mcol_2 = MeshColours(Mesh=graft(gate.Target1), Colours=weave)  # -> flatten(Mesh)

# ----
item = ListItem(List=type_colors, Index=graft(aotype), Wrap=True)  # -> simplify(Item)

# ---- group: display by component type
mcol_3 = MeshColours(Mesh=graft(gate.Target2), Colours=item)  # -> flatten(Mesh)

# ----
mcol_4 = MeshColours(Mesh=gate.Target0, Colours=ColourSwatch(SwatchColor=RGB(255, 255, 255)))
filter_2 = StreamFilter(Gate=vizmode, Stream0=mcol_4, Stream1=mcol_2, Stream2=mcol_3, Stream3=mcol)
filter_3 = StreamFilter(Gate=stop_and_go_bool, Stream0=filter_2)

# ---- group: extract edges with angle tolerance (many meshes)
f_mmeea = MeshesExtractEdgesWithToleranceAngle(Mesh=filter_3, Angle="45")  # -> flatten(InternalEdges), NakedEdges

# ----
meshes = ClusterOutput(filter_2)
edges = ClusterOutput(f_mmeea.InternalEdges)
