# Grasshopper definition Filter duplicate blocks.gh (Grasshopper 1.0.7)
# Copyright: Co-de-iT
# plug-ins: EleFront

listblockd = ListBlockDocument()
# <title>
# 
# <description>
# 
# code by Alessio Erioli
# 
# v 0.1
# © Co-de-iT 2020 / Creative Commons Attribution-Non Commercial-ShareAlike 4.0 International License
panel = Panel(listblockd)
item = ListItem(List=listblockd, Index=Slider(1, range=1..7), Wrap=True)
refblock = ReferenceBlockByName(BlockName=item)
deblock = DeconstructBlock(Block=refblock)  # -> Name, flatten(Plane), Geometry
cullpt = CullDuplicates(Points=deblock.Plane, Tolerance=0.1, CullMode=1)  # -> Points, Indices, Valence
item_2 = ListItem(List=deblock.Plane, Index=cullpt.Indices, Wrap=True)
panel_2 = Panel(cullpt.Indices)
X = UnitX(Factor="-500")
move = Move(Geometry=item_2, Motion=X)  # -> Geometry, Transform
inblock = InsertBlock(BlockName=item, SourcePlane=move.Geometry)
bake = BakeObjects(Geometry=inblock, Bake=Toggle(False))
