# Grasshopper definition display Assemblage.gh (Grasshopper 1.0.7)
# Copyright: Co-de-iT
# plug-ins: Human

assemblage = Relay()
stop_go = Relay()
display = ValueList({"objects": 0, "occupancy": 1, "type": 2, "sequence": 3, "none": 4}, selected="type")
panel = Panel("""AliceBlue
SlateGray
GoldenRod
YellowGreen
DarkKhaki""")
# <title>
# 
# <description>
# 
# code by Alessio Erioli
# 
# v 0.1
# © Co-de-iT 2020 / Creative Commons Attribution-Non Commercial-ShareAlike 4.0 International License
cluster = Cluster(vizmode=display, assemblage=assemblage, type_colors=panel, stop_and_go_bool=stop_go)  # -> meshes, edges

# ---- group: display components
mjoin = MeshJoin(Meshes=cluster.meshes)
preview = CustomPreview(
    Geometry=mjoin,
    Material={diffuse=RGB(221, 160, 221), emission=RGB(66, 48, 66), shine=0.5, specular=RGB(255, 255, 255), transparency=0})

# ---- group: display components / display edges
previewlw = CustomPreviewLineweights(Geometry=cluster.edges, Shader=ColourSwatch(SwatchColor=RGB(0, 0, 0)), Thickness=Slider(1, range=1..3), Absolute=False)

# ==== cluster Cluster
vizmode = ClusterInput()
assemblage = ClusterInput()
type_colors = ClusterInput()
stop_and_go_bool = ClusterInput()
aoadecon = DeconstructAssemblage(Assemblage=assemblage)  # -> AssemblageObjects, AssemblageRules, ReceiverObjectsIndexes, AvailableObjectIndexes, UnreachableObjectIndexes

# ---- group: extract collision meshes
aocmesh = ExtractCollisionMesh(AssemblyObject=aoadecon.AssemblageObjects)

# ----
gate = StreamGate(Stream=aocmesh, Gate=vizmode)  # -> Target0, Target1, Target2, Target3, Target4

# ---- group: extract object type
aotype = ExtractType(AssemblyObject=aoadecon.AssemblageObjects)

# ----
filter = StreamFilter(Gate=stop_and_go_bool, Stream0=gate.Target3)
lng = ListLength(List=gate.Target1)
repeat = RepeatData(Data="0", Length=lng)

# ---- group: display by assemblage sequence
lng_2 = ListLength(List=filter)  # -> expr("x-1", Length)
f_ifroml = IndexesFromList(D=filter)  # -> i; inputs D: list
# ---------- f_ifroml: C# usings ----------
using System.Linq;
# ---------- f_ifroml: C# ----------
   
 /*
    froGH - a sparse collection of (in)utilities for Grasshopper

    Indexes from Number
    code by Alessio Erioli

    froGH by Co-de-iT is licensed under a Creative Commons Attribution 4.0 International License.
    http://creativecommons.org/licenses/by/4.0/

    */
    initComp();
   
    GH_Integer[] indexes = new GH_Integer[D.Count];

    for(int j = 0; j < D.Count; j++)
      indexes[j] = new GH_Integer(j);

    //A = indexes.Sum(j => j.Value); // uses System.Linq Sum selector function - for each GH_Integer j in indexes add its value to the total sum

    i = indexes;
# ---------- f_ifroml: C# additional code ----------
  void initComp(){
    Component.Name = "Indexes from List";
    Component.NickName = "f_iFromL";
    Component.Description = "Generates a list of 0-based integer indexes from a given list of data";
    Component.Params.Input[0].Name = "Data";
    Component.Params.Input[0].Description = "the list to index";
    Component.Params.Output[0].Name = "Indexes";
    Component.Params.Output[0].Description = "the generated indexes";
  }
# ---------- end f_ifroml ----------
one_over_x = OneOverX(Value=lng_2)
multiplication = Multiplication(A=f_ifroml, B=one_over_x)
sqr = Square(Value=multiplication)
gradient = Gradient(
    LowerLimit=0,
    UpperLimit=1,
    Parameter=sqr,
    stops=[0: RGB(0, 0, 0), 0.498: RGB(56, 136, 150), 0.904: RGB(186, 224, 224), 1: RGB(255, 255, 255)])
mcol = MeshColours(Mesh=graft(filter), Colours=graft(gradient))  # -> flatten(Mesh)

# ----
replace = ReplaceItems(List=repeat, Item="1", Indices=aoadecon.AvailableObjectIndexes, Wrap=False)
replace_2 = ReplaceItems(List=replace, Item="2", Indices=aoadecon.UnreachableObjectIndexes, Wrap=False)

# ---- group: occupied/available visualization
saturated = ColourSwatch(SwatchColor=RGB(112, 117, 57))
available = ColourSwatch(SwatchColor=RGB(255, 255, 255))
unreachable = ColourSwatch(SwatchColor=RGB(194, 199, 137))
weave = Weave(Pattern=graft(replace_2), Stream0=saturated, Stream1=available, Stream2=unreachable, NullGaps=False)  # -> simplify(Weave)
mcol_2 = MeshColours(Mesh=graft(gate.Target1), Colours=weave)  # -> flatten(Mesh)

# ----
item = ListItem(List=type_colors, Index=graft(aotype), Wrap=True)  # -> simplify(Item)

# ---- group: display by component type
mcol_3 = MeshColours(Mesh=graft(gate.Target2), Colours=item)  # -> flatten(Mesh)

# ----
mcol_4 = MeshColours(Mesh=gate.Target0, Colours=ColourSwatch(SwatchColor=RGB(255, 255, 255)))
filter_2 = StreamFilter(Gate=vizmode, Stream0=mcol_4, Stream1=mcol_2, Stream2=mcol_3, Stream3=mcol)
filter_3 = StreamFilter(Gate=stop_and_go_bool, Stream0=filter_2)

# ---- group: extract edges with angle tolerance (many meshes)
f_mmeea = MeshesExtractEdgesWithToleranceAngle(Mesh=filter_3, Angle="45")  # -> flatten(InternalEdges), NakedEdges

# ----
meshes = ClusterOutput(filter_2)
edges = ClusterOutput(f_mmeea.InternalEdges)
