# Grasshopper definition filtering - selective geometry.gh (Grasshopper 1.0.7)
# Copyright: Co-de-iT
# plug-ins: Noise 4D, Assembler, froGH

# <title>
# 
# <description>
# 
# code by Alessio Erioli
# 
# v 0.1
# © Co-de-iT 2020 / Creative Commons Attribution-Non Commercial-ShareAlike 4.0 International License
assemblage = Relay()
aoadecon = DeconstructAssemblage(Assemblage=assemblage)  # -> AssemblageObjects, AssemblageRules, ReceiverObjectsIndexes, AvailableObjectIndexes, UnreachableObjectIndexes
xdata = Relay()
# component filtering operations
aocmesh = ExtractCollisionMesh(AssemblyObject=aoadecon.AssemblageObjects)
aoplane = ExtractReferencePlane(AssemblyObject=aoadecon.AssemblageObjects)
aotype = ExtractType(AssemblyObject=aoadecon.AssemblageObjects)

# ---- group: circle-defined neighborhood
# 2D circle inclusion
md_slider = MDSlider(
    SliderMode=0,
    slider_value=Point(0.4631987781, 0.5887711688, 0.5),
    x_domain=Domain(0, 1),
    y_domain=Domain(0, 1),
    z_domain=Domain(0, 1))
devec = DeconstructVector(Vector=md_slider)  # -> XComponent, YComponent, ZComponent
bbox = BoundingBox(Content=aocmesh, Plane=PlaneXY(0, 0, 0), UnionBox=True)  # -> Box, Box_2
boxprop = BoxProperties(Box=bbox.Box)  # -> Center, Diagonal, Area, Volume, Degeneracy
box = EvaluateBox(Box=bbox.Box, UParameter=devec.XComponent, VParameter=devec.YComponent, WParameter=devec.ZComponent)  # -> Plane, Point, Include
devec_2 = DeconstructVector(Vector=boxprop.Diagonal)  # -> XComponent, YComponent, ZComponent
multiplication = Multiplication(A=devec_2.ZComponent, B="-0.3")
number_slider = Slider(2512.597, range=0..10000)
Z = UnitZ(Factor=multiplication)
move = Move(Geometry=box.Plane, Motion=Z)  # -> Geometry, Transform
cir = Circle(Plane=move.Geometry, Radius=number_slider)
project = Project(Geometry=aoplane, Plane=move.Geometry)  # -> Geometry, Transform
f_ptssph = PointsInSphere(SphereCenter=box.Point, PointsToSearch=project.Geometry, SearchRadius=number_slider)  # -> Points, PointsIndexes

# ----
type_colors = Panel("""AliceBlue
SlateGray
GoldenRod
YellowGreen
DarkKhaki""")
aoaxd = AssociateXData(Assemblage=assemblage, XData=xdata)

item = ListItem(List=type_colors, Index=aotype, Wrap=True)  # -> flatten(Item)
preview = CustomPreview(Geometry=project.Geometry, Material=item)

# ---- group: selection area
preview_2 = CustomPreview(Geometry=cir, Material=ColourSwatch(SwatchColor=RGB(151, 255, 87)))

# ---- group: circle selection
int = Integer(f_ptssph.PointsIndexes)

# ---- group: from shortest walk
int_2 = Integer()

# ---- group: shortlisted indexes
int_3 = Integer(int)

# ---- group: sort by component type
sift = SiftPattern(List=aoaxd, SiftPattern=aotype)  # -> Output0, Output1
xddecon = DeconstructXData(XData=sift.Output0)  # -> Label, Data, ReferencePlane, AssemblyObjectNameReference
xddecon_2 = DeconstructXData(XData=sift.Output1)  # -> Label, Data, ReferencePlane, AssemblyObjectNameReference
crv = Curve(xddecon_2.Data)
crv_2 = Curve(xddecon.Data)

# ----
aocmesh_2 = ExtractCollisionMesh(AssemblyObject=aoadecon.AssemblageObjects)
xddecon_3 = DeconstructXData(XData=aoaxd)  # -> Label, Data, ReferencePlane, AssemblyObjectNameReference

# ---- group: shortlisted objects
# extra geometry operations
item_2 = ListItem(List=aocmesh_2, Index=int_3, Wrap=True)

# ---- group: all other objects
cull_i = CullIndex(List=aocmesh_2, Indices=int_3, Wrap=True)

# ---- group: sort by area
crv_3 = Curve(flatten(xddecon_3.Data))
area = Area(Geometry=crv_3)  # -> Area, Centroid
expression = Expression(x=area.Area, Expression="Round(x/10000,3)")
cset = CreateSet(List=expression)  # -> Set, Map
mindex = MemberIndex(Set=expression, Member=graft(cset.Set))  # -> Index, Count
panel = Panel(cset.Set)
item_3 = ListItem(List=crv_3, Index=mindex.Index, Wrap=True)  # -> simplify(Item)

# ----
# selective geometry integration
mesh_col = ColourSwatch(SwatchColor=RGBA(250, 250, 250, 10))
preview_3 = CustomPreview(Geometry=cull_i, Material=mesh_col)

shader = Shader({diffuse=RGB(230, 230, 230), emission=RGB(0, 0, 0), shine=0, specular=RGB(255, 255, 255), transparency=0.178415224})
preview_4 = CustomPreview(Geometry=item_2, Material=shader)

# ---- group: selective geometry integration / extract type 1 cells in neighborhood
item_4 = ListItem(List=aotype, Index=int_3, Wrap=True)
equals = Equality(FirstNumber=item_4, SecondNumber="1")  # -> Equality, Inequality
cull = CullPattern(List=int_3, CullPattern=equals.Equality)

# ---- group: extract reference plane for alignment
item_5 = ListItem(List=aoadecon.AssemblageObjects, Index=cull, Wrap=True)
aoplane_2 = ExtractReferencePlane(AssemblyObject=item_5)

# ---- group: rotated louvers based on scalar data field (noise) / basic louver
f_cdom = CenteredDomain(DomainLength=Slider(50.445, range=0..100))
f_cdom_2 = CenteredDomain(DomainLength=Slider(2, range=0..100))
box_2 = DomainBox(Base=PlaneXY(0, 0, 0), X=f_cdom, Y=f_cdom_2, Z=Slider(30, range=0..50))
# façades built on reference polylines
panel_2 = Panel("1")
mbox = MeshBox(Base=box_2, XCount=panel_2, YCount=panel_2, ZCount=panel_2)

# ----
aocmesh_3 = ExtractCollisionMesh(AssemblyObject=item_5)

# ---- group: selective geometry XData
data = Data()

# ----
bang = ExplodeTree(Data=item_3)  # -> Branch0, Branch1, Branch2, Branch3
xddecon_4 = DeconstructXData(XData=data)  # -> Label, Data, ReferencePlane, AssemblyObjectNameReference

# ---- group: selective geometry integration
type_1_cells_index = Panel(cull)
orient = Orient(Geometry=xddecon_4.Data, Source=xddecon_4.ReferencePlane, Target=aoplane_2)  # -> Geometry, Transform

preview_5 = CustomPreview(Geometry=orient.Geometry, Material=ColourSwatch(SwatchColor=RGB(8, 177, 199)))

# ---- group: find cells closest to containmen walls
# containment wall proximity
containment_mesh = Relay()
wall_threshold = Slider(463.964, range=0..500)
f_ifroml = IndexesFromList(Data=aoplane)

# ---- group: find cells closest to containmen walls / isolate containment walls
facen = FaceNormals(Mesh=containment_mesh)  # -> Centers, Normals
Z_2 = UnitZ(Factor=1)
dprod = DotProduct(VectorA=facen.Normals, VectorB=Z_2, Unitize=False)
abs = Absolute(Value=dprod)
similar = Similarity(FirstNumber=abs, SecondNumber="1", Threshold=0.1)  # -> Similarity, AbsoluteDifference
cullf = CullFaces(Mesh=containment_mesh, Pattern=similar.Similarity)

# ---- group: find cells closest to containmen walls (continued)
meshcp = MeshClosestPoint(Point=aoplane, Mesh=cullf)  # -> simplify(Point), Index, Parameter
dist = Distance(PointA=aoplane, PointB=meshcp.Point)
smaller = SmallerThan(FirstNumber=dist, SecondNumber=wall_threshold)  # -> SmallerThan, OrEqualTo
cull_2 = CullPattern(List=f_ifroml, CullPattern=flatten(smaller.SmallerThan))

# ---- group: find cells closest to containmen walls / planes
cull_3 = CullPattern(List=aoplane, CullPattern=smaller.SmallerThan)

# ---- group: perimeter selection
int_4 = Integer(cull_2)

# ---- group: shortlisted indexes
int_5 = Integer(int_4)

# ---- group: extract type 1 cells in neighborhood
# façade operations
item_6 = ListItem(List=aotype, Index=int_5, Wrap=True)
equals_2 = Equality(FirstNumber=item_6, SecondNumber="1")  # -> Equality, Inequality
cull_4 = CullPattern(List=int_5, CullPattern=equals_2.Equality)

# ---- group: rotated louvers based on scalar data field (noise)
branch = TreeBranch(Tree=simplify(crv_2), Path=cull_4, MaintainPaths=True)
mesh_uv = MeshSurface(Surface=branch, UCount=Slider(20, range=5..20), VCount=Slider(5, range=5..20), Overhang=True, Equalize=False)  # -> simplify(Mesh)
facen_2 = FaceNormals(Mesh=mesh_uv)  # -> Centers, Normals
pl = PlaneNormal(Origin=facen_2.Centers, ZAxis=facen_2.Normals)

# ---- group: rotated louvers based on scalar data field (noise) / discrete rotation by noise
perlin = PerlinNoise(Values=facen_2.Centers, Time=Slider(0, range=0..10), Scale=Slider(0.005, range=0..1))
multiplication_2 = Multiplication(A=perlin, B="4")
int_6 = Integer(multiplication_2)
multiplication_3 = Multiplication(A=int_6, B="Pi*0.25")

# ---- group: rotated louvers based on scalar data field (noise) (continued)
prot = RotatePlane(Plane=pl, Angle=multiplication_3)
orient_2 = Orient(Geometry=mbox, Source=PlaneXY(0, 0, 0), Target=prot)  # -> Geometry, Transform

# ----
louvers = ColourSwatch(SwatchColor=RGB(0, 0, 0))
wall = ColourSwatch(SwatchColor=RGB(255, 255, 255))
preview_6 = CustomPreview(Geometry=mesh_uv, Material=wall)  # disabled
preview_7 = CustomPreview(Geometry=orient_2.Geometry, Material=louvers)  # disabled
